% Simulink data dictionary prob4_data.sldd

J = Simulink.Parameter(3.2284e-6)
Ke = Simulink.Parameter(0.0274)
Kt = Simulink.Parameter(0.0274)
L = Simulink.Parameter(2.75e-6)
R = Simulink.Parameter(4)
b = Simulink.Parameter(3.5077e-6)
n = Simulink.Parameter(119000)
Kp = Simulink.Parameter(80)
Kd = Simulink.Parameter(1)
Ki = Simulink.Parameter(4000)